# Grasshopper definition BSUG_EnergyModel.gh (Grasshopper 1.0.7)
# plug-ins: ItemSelector, Spectacles.GrasshopperExporter, Ironbug, Colibri

ladybug = Ladybug_Ladybug()  # -> Vviiiiiiiiiizzz; plug-in component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
honeybee = Honeybee_Honeybee()  # -> Vviiiiiiiiiizzz; plug-in component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

# ----
# Geometry
# Simple Test Box Creation
# gbXML Import
Z = Slider(10, range=0..20)
X = Slider(100, range=0..100)
Y = Slider(100, range=0..100)
ft_m_conversion = Panel("3.2808")
division = Division(Ft=graft([X, Y, Z]), B=ft_m_conversion)
bang = ExplodeTree(Data=division)  # -> Branch0, Branch1, Branch2
xmltohb = Honeybee_gbXMLToHoneybee()  # -> readMe, model, HBZones, shadings; plug-in component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
perimeter_zone_depth_ft = Panel("15")
box = DomainBox(Base=PlaneXY(0, 0, 0), X=bang.Branch0, Y=bang.Branch1, Z=bang.Branch2)
ft_m_conversion_2 = Panel("3.2808")
geo = Geometry(box)
division_2 = Division(Ft=graft(perimeter_zone_depth_ft), B=ft_m_conversion_2)
split2zone = Honeybee_SplitFloor2ThermalZones(bldgFloors=flatten(box), perimeterZoneDepth=division_2, runIt=Toggle(True))  # -> readMe, splitBldgZones; plug-in component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
mass2zone = Honeybee_Masses2Zones(zoneMasses=flatten(split2zone.splitBldgZones), maxRoofAngle=30, createHBZones=Toggle(True))  # -> readMe, HBZones; plug-in component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

panel = Panel(honeybee)
geo_2 = Geometry(mass2zone.HBZones)

# ----
# Parameters We're
# Interested In
rotation_from_north = ValueList({"0", "30", "60", "90", "120", "150"}, selected="30")
glass_u_value = ValueList({"0.25", "0.35", "0.45"}, selected="0.35")
glass_shgc = ValueList({"0.3", "0.4"}, selected="0.4")
roof_r = ValueList({"20", "30", "40"}, selected="30")
wall_r = ValueList({"15", "20", "25"}, selected="20")
wwr = ValueList({"0.2", "0.3", "0.4"}, selected="0.4")

# ----
# Rotate Geometry
toggle = BooleanToggle(True)
rotatehbobj = Honeybee_RotateHoneybee(HBObj=flatten(mass2zone.HBZones), angle=rotation_from_north, keepAdj=toggle)  # -> HBObj; plug-in component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

# ----
# Solve Adjacencies
toggle_2 = BooleanToggle(True)
solveadjc = Honeybee_SolveAdjacencies(HBZones=flatten(rotatehbobj), removeCurrentAdjc=False, findAdjc=toggle_2)  # -> readMe, HBZonesWADJ; plug-in component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

# ----
# Zone Settings
# Set Space Type
# Schedules
# Loads
# Setpoints
panel_2 = Panel("medium office clgsetp")
temps_f = Panel("""75
80
72
65""")
bldgprograms = Honeybee_bldgPrograms({"Office": 0, "Retail": 1, "MidriseApartment": 2, "PrimarySchool": 3, "SecondarySchool": 4, "SmallHotel": 5, "LargeHotel": 6, "Hospital": 7, "Outpatient": 8, "Warehouse": 9, "SuperMarket": 10, "FullServiceRestaurant": 11, "QuickServiceRestaurant": 12}, selected="Office")
callfromepschlibrary = Honeybee_CallFromEPScheduleLibrary(keywords=panel_2)  # -> scheduleTypeLimits, scheduleList; plug-in component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
panel_3 = Panel(callfromepschlibrary.scheduleList)
lpd_w_ft2 = Panel("0.75")
f2c = Ladybug_F2C(F=temps_f)  # -> C; plug-in component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
bang_2 = ExplodeTree(Data=graft(f2c))  # -> Branch0, Branch1, Branch2, Branch3
multiplication = Multiplication(A=lpd_w_ft2, B="10.764")
listzoneprograms = Honeybee_ListZonePrograms(bldgProgram=bldgprograms)  # -> OfficeZonePrograms; plug-in component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
list = Honeybee_ItemSelector(
    listzoneprograms,
    {"Office::BreakRoom", "Office::Storage", "Office::Vending", "Office::OpenOffice", "Office::ClosedOffice", "Office::Conference", "Office::PrintRoom", "Office::Restroom", "Office::Elec/MechRoom", "Office::IT_Room", "Office::Stair", "Office::Corridor", "Office::Lobby"}, selected="Office::OpenOffice")
setloadsandschedules = Honeybee_SetLoadsAndSchedules(HBZones=flatten(solveadjc.HBZonesWADJ), zonePrograms=list)  # -> currentSchedules, currentLoads, HBZones; plug-in component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
setepzoneschedules = Honeybee_SetEnergyPlusZoneSchedules(HBZones=setloadsandschedules.HBZones)  # -> schedules, simplify(HBZones); plug-in component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
setepzoneloads = Honeybee_SetEnergyPlusZoneLoads(HBZones=setepzoneschedules.HBZones, lightingDensityPerArea=multiplication)  # -> loads, HBZones; plug-in component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
setepzonethresholds = Honeybee_SetEnergyPlusZoneThresholds(
    HBZones=setepzoneloads.HBZones,
    coolingSetPt=bang_2.Branch0,
    coolingSetback=bang_2.Branch1,
    heatingSetPt=bang_2.Branch2,
    heatingSetback=bang_2.Branch3)  # -> readMe, HBZones; plug-in component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
zone_schedules = Panel(setepzoneschedules.schedules)
zone_loads = Panel(setepzoneloads.loads)

iterator = ColibriIterator(
    Rotation_from_North=rotation_from_north,
    WWR=wwr,
    Glass_U_Value=glass_u_value,
    Glass_SHGC=glass_shgc,
    Wall_R=wall_r,
    Roof_R=roof_r,
    RemoteFly=False,
    ignoreAllWarningMsg=False)  # -> Rotation_from_North, WWR, Glass_U_Value, Glass_SHGC, Wall_R, Roof_R, Genome

# ----
# Set Glazing %
glzparamlist = Honeybee_GlazingParametersList(northGlzParam=0, westGlzParam=0, southGlzParam=0, eastGlzParam=0)  # -> glzParamList; plug-in component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
glazingcreator = Honeybee_GlazingBasedOnRatio(HBObjects=setepzonethresholds.HBZones, glzRatio=wwr, breakUpWindow=Toggle(True), runIt=Toggle(True))  # -> readMe, HBObjWGLZ; plug-in component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

# ----
# Constructions
# Walls
# Windows
# Roofs
# Floors
panel_4 = Panel("EXTSLABCARPET 4IN Climatezone 1-8")
rip2rsi = Ladybug_rIP2rSI(R_IP=roof_r)  # -> R_SI; plug-in component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
rip2rsi_2 = Ladybug_rIP2rSI(R_IP=wall_r)  # -> R_SI; plug-in component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
uip2usi = Ladybug_uIP2uSI(U_IP=glass_u_value)  # -> U_SI; plug-in component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
callfromepconstrlibrary = Honeybee_CallFromEPConstructionLibrary(keywords="1/2IN GYPSUM")  # -> ThermMaterials, EPMaterials, EPWindowMaterials, EPConstructions; plug-in component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
callfromepconstrlibrary_2 = Honeybee_CallFromEPConstructionLibrary(keywords="Wood Siding")  # -> ThermMaterials, EPMaterials, EPWindowMaterials, EPConstructions; plug-in component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
callfromepconstrlibrary_3 = Honeybee_CallFromEPConstructionLibrary(keywords="Roof Membrane")  # -> ThermMaterials, EPMaterials, EPWindowMaterials, EPConstructions; plug-in component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
callfromepconstrlibrary_4 = Honeybee_CallFromEPConstructionLibrary(keywords="Metal Decking")  # -> ThermMaterials, EPMaterials, EPWindowMaterials, EPConstructions; plug-in component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
callfromepconstrlibrary_5 = Honeybee_CallFromEPConstructionLibrary(keywords=panel_4)  # -> ThermMaterials, EPMaterials, EPWindowMaterials, EPConstructions; plug-in component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
epnomassmat = Honeybee_EnergyPlusNoMassOpaqueMaterial(name="Insulation_Wall", R_Value=rip2rsi_2)  # -> EPMaterial; plug-in component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
epnomassmat_2 = Honeybee_EnergyPlusNoMassOpaqueMaterial(name="Insulation_Roof", R_Value=rip2rsi)  # -> EPMaterial; plug-in component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
epwindowmat = Honeybee_EnergyPlusWindowMaterial(name="Shoebox_Glazing", U_Value=uip2usi, SHGC=glass_shgc, VT="0.6")  # -> EPMaterial; plug-in component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
epconstruction = Honeybee_EnergyPlusConstruction(name="Shoebox_Window", layer_1=epwindowmat)  # -> EPConstruction; plug-in component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
epconstruction_2 = Honeybee_EnergyPlusConstruction(
    name="Shoebox_Roof",
    layer_1=callfromepconstrlibrary_3.EPMaterials,
    layer_2=epnomassmat_2,
    layer_3=callfromepconstrlibrary_4.EPMaterials)  # -> EPConstruction; plug-in component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
epconstruction_3 = Honeybee_EnergyPlusConstruction(
    name="Shoebox_Wall",
    layer_1=callfromepconstrlibrary_2.EPMaterials,
    layer_2=epnomassmat,
    layer_3=callfromepconstrlibrary.EPMaterials)  # -> EPConstruction; plug-in component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
setepzonecnstr = Honeybee_SetEPZoneConstruction(
    HBZones=flatten(glazingcreator.HBObjWGLZ),
    wallEPConstruction=epconstruction_3,
    windowEPConstruction=epconstruction,
    roofEPConstruction=epconstruction_2,
    floorEPConstruction=callfromepconstrlibrary_5.EPConstructions)  # -> simplify(modifiedHBZones); plug-in component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

# ----
# HVAC System
# Ironbug
# Default
hvacsystemslist = Honeybee_HVACSystemsList({"-1. Thermostat Only": -1, "0. Ideal Air Loads": 0, "1. PTAC | Residential": 1, "2. PTHP | Residential": 2, "3. Packaged Single Zone - AC": 3, "4. Packaged Single Zone - HP": 4, "5. Packaged VAV w/ Reheat": 5, "6. Packaged VAV w/ PFP Boxes": 6, "7. VAV w/ Reheat": 7, "8. VAV w/ PFP Boxes": 8, "9. Warm Air Furnace - Gas Fired": 9, "10.Warm Air Furnace - Electric": 10, "11.Fan Coil Units + DOAS": 11, "12.Active Chilled Beams + DOAS": 12, "13.Radiant Floors + DOAS": 13, "14.Custom Rad Surfaces + DOAS": 14, "15.Heated Surfaces + VAV Cooling": 15, "16.VRF + DOAS": 16, "17.WSHP + DOAS": 17}, selected="3. Packaged Single Zone - AC")
coolingdetails = Honeybee_HVACCoolingDetails()  # -> coolingDetails; plug-in component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
heatingdetails = Honeybee_HVACHeatingDetails()  # -> heatingDetails; plug-in component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
airdetails = Honeybee_HVACAirDetails()  # -> airDetails; plug-in component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
hvactemplate = Ironbug_HVACTemplate()
hvacsystem = Honeybee_AssignHVACSystem(HBZones=flatten(setepzonecnstr), HVACSystems=hvacsystemslist)  # -> readMe, HBZones; plug-in component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

# ---- group: Sys05_PackagedVAV Reheat
# Double click the component for more details
sys05 = Sys05(hbzones=flatten(setepzonecnstr))

# ----
# Weather Import
panel_5 = Panel("https://energyplus.net/weather-download/north_and_central_america_wmo_region_4/USA/ID/USA_ID_Boise.Air.Terminal.726810_TMY3/all")
epw_stat = Ladybug_OpenEPWAndSTATWeatherFiles(weatherFileURL=panel_5)  # -> epwFile, statFile; plug-in component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

# ----
# OpenStudio Simulation
# Simulation Settings
solardistribution = ValueList({"Minimal Shading": 0, "FullExterior": 1, "FullInteriorAndExterior": 2}, selected="FullExterior")
simcontrol = Honeybee_SimulationControl()  # -> simControls; plug-in component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
epoutput = Honeybee_GenerateEPOutput(zoneEnergyUse=Toggle(True), zoneGainsAndLosses="False", zoneComfortMetrics="False", surfaceTempAnalysis="False")  # -> report, flatten(simulationOutputs); plug-in component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
energysimpar = Honeybee_EnergySimulationPar(timestep="6", solarDistribution=solardistribution, simulationControls=simcontrol)  # -> energySimPar; plug-in component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
toggle_3 = BooleanToggle(False)
exporttoopenstudio = Honeybee_ExportToOpenStudio(
    epwWeatherFile=epw_stat.epwFile,
    energySimPar=energysimpar,
    HBZones=flatten(setepzonecnstr),
    HVACSystem=flatten(sys05),
    simulationOutputs=flatten(epoutput.simulationOutputs),
    writeOSM=toggle_3,
    runSimulation=toggle_3)  # -> readMe, osmFileAddress, idfFileAddress, resultFileAddress, eioFileAddress, rddFileAddress, htmlReport, studyFolder, model; plug-in component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
panel_6 = Panel(exporttoopenstudio.readMe)
opendir = LBOpenDirectory(file_path=exporttoopenstudio.htmlReport)  # -> report; disabled; plug-in component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

context_geometry = Geometry()

# ----
# Visualize Geometry
pt = Point(Point(-5.027658739, -5.836500196, 0))
zoneattributelist = Honeybee_ZoneAttributeList({"Name": "name", "Zone Program": "zoneProgram", "Zone Floor Area": "zoneFloorArea", "Zone Volume": "zoneVolume", "Building Program": "bldgProgram", "Is Conditioned": "isConditioned", "HVAC System Type": "HVACSystem", "Occupancy Schedule": "occupancySchedule", "Occupancy Activity Schedule": "occupancyActivitySch", "Heating SetPoint Schedule": "heatingSetPtSchedule"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}, selected="Name")
northarrow = Ladybug_North(centerPt=pt, scale="0.25")  # -> northSign; plug-in component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
swatch = ColourSwatch(SwatchColor=RGB(0, 0, 0))
preview = CustomPreview(Geometry=northarrow, Material=swatch)
building_geometry = Geometry(glazingcreator.HBObjWGLZ)
preview_2 = CustomPreview(Geometry=context_geometry, Shader=ColourSwatch(SwatchColor=RGB(109, 43, 148)))
decomposebytype = Honeybee_DecomposeBasedOnType(HBZone=flatten(building_geometry))  # -> walls, interiorWalls, airWalls, windows, interiorWindows, skylights, roofs, ceilings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; plug-in component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
labelzones = Honeybee_LabelZones(HBZones=flatten(building_geometry), attribute=zoneattributelist)  # -> zoneTxtLabels, labelBasePts, brepTxtLabels, zoneWireFrames; plug-in component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
swatch_2 = ColourSwatch(SwatchColor=RGBA(156, 242, 255, 147))
swatch_3 = ColourSwatch(SwatchColor=RGB(209, 185, 125))
swatch_4 = ColourSwatch(SwatchColor=RGB(194, 81, 81))
swatch_5 = ColourSwatch(SwatchColor=RGB(102, 93, 93))
edges = BrepEdges(Brep=[context_geometry, building_geometry])  # -> Naked, Interior, NonManifold
preview_3 = CustomPreview(Geometry=flatten([decomposebytype.windows, decomposebytype.interiorWindows]), Shader=swatch_2)
preview_4 = CustomPreview(Geometry=edges.Interior, Shader=ColourSwatch(SwatchColor=RGB(0, 0, 0)))
preview_5 = CustomPreview(Geometry=decomposebytype.walls, Shader=swatch_3)
preview_6 = CustomPreview(Geometry=decomposebytype.roofs, Shader=swatch_4)
preview_7 = CustomPreview(Geometry=[decomposebytype.exposedFloors, decomposebytype.floors, decomposebytype.groundFloors], Shader=swatch_5)

bang_3 = ExplodeTree(Data=graft(northarrow))  # -> Branch0, Branch1, Branch2

# ----
# Creating 3D Design Explorer Image
# Lines
# Meshes
wires = BrepWireframe(Brep=building_geometry, Density=-1)
mesh = MeshBrep(
    Brep=bang_3.Branch0,
    Settings={GridMaxCount=0, GridMinCount=16, JaggedSeams=False, MaxEdgeLength=0, MinEdgeLength=0.0001, MinTolerance=0, Refine=True, RefineAngle=0, RelativeTolerance=0.65, SimplePlanes=True, Tolerance=0})
mesh_2 = MeshBrep(
    Brep=decomposebytype.windows,
    Settings={GridMaxCount=0, GridMinCount=16, JaggedSeams=False, MaxEdgeLength=0, MinEdgeLength=0.0001, MinTolerance=0, Refine=True, RefineAngle=0, RelativeTolerance=0.65, SimplePlanes=True, Tolerance=0})
mesh_3 = MeshBrep(
    Brep=decomposebytype.roofs,
    Settings={GridMaxCount=0, GridMinCount=16, JaggedSeams=False, MaxEdgeLength=0, MinEdgeLength=0.0001, MinTolerance=0, Refine=True, RefineAngle=0, RelativeTolerance=0.65, SimplePlanes=True, Tolerance=0})
mesh_4 = MeshBrep(
    Brep=[decomposebytype.exposedFloors, decomposebytype.floors, decomposebytype.groundFloors],
    Settings={GridMaxCount=0, GridMinCount=16, JaggedSeams=False, MaxEdgeLength=0, MinEdgeLength=0.0001, MinTolerance=0, Refine=True, RefineAngle=0, RelativeTolerance=0.65, SimplePlanes=True, Tolerance=0})
mesh_5 = MeshBrep(
    Brep=decomposebytype.walls,
    Settings={GridMaxCount=0, GridMinCount=16, JaggedSeams=False, MaxEdgeLength=0, MinEdgeLength=0.0001, MinTolerance=0, Refine=True, RefineAngle=0, RelativeTolerance=0.65, SimplePlanes=True, Tolerance=0})
line = Line(flatten([wires, bang_3.Branch1, bang_3.Branch2]))
spectacles_meshbasicmaterial = Spectacles_MeshBasicMaterial(Color=swatch, Object_Opacity="0.95")
spectacles_meshbasicmaterial_2 = Spectacles_MeshBasicMaterial(Color=swatch_2, Object_Opacity="0.75")
spectacles_meshbasicmaterial_3 = Spectacles_MeshBasicMaterial(Color=swatch_4, Object_Opacity="0.9")
spectacles_meshbasicmaterial_4 = Spectacles_MeshBasicMaterial(Color=swatch_5, Object_Opacity="0.9")
spectacles_linebasicmaterial = Spectacles_LineBasicMaterial(Color=ColourSwatch(SwatchColor=RGB(0, 0, 0)), LineWeight=1)
spectacles_meshbasicmaterial_5 = Spectacles_MeshBasicMaterial(Color=swatch_3, Object_Opacity="0.9")
spectacles_line = Spectacles_Line(Line=line, LineMaterial=spectacles_linebasicmaterial)
spectacles_mesh = Spectacles_Mesh(Mesh=mesh, MeshMaterial=spectacles_meshbasicmaterial)
spectacles_mesh_2 = Spectacles_Mesh(Mesh=mesh_2, MeshMaterial=spectacles_meshbasicmaterial_2)
spectacles_mesh_3 = Spectacles_Mesh(Mesh=mesh_3, MeshMaterial=spectacles_meshbasicmaterial_3)
spectacles_mesh_4 = Spectacles_Mesh(Mesh=mesh_4, MeshMaterial=spectacles_meshbasicmaterial_4)
spectacles_mesh_5 = Spectacles_Mesh(Mesh=mesh_5, MeshMaterial=spectacles_meshbasicmaterial_5)
_3dobjects = SpectaclesColibri_3DObjects(Elements=flatten([spectacles_mesh_3, spectacles_line, spectacles_mesh_2, spectacles_mesh_5, spectacles_mesh_4, spectacles_mesh]))

# ----
# Post-Process Energy Model Results
readepresult = Honeybee_ReadEPResult(resultFileAddress=exporttoopenstudio.resultFileAddress)  # -> totalThermalLoad, thermalLoadBalance, cooling, heating, electricLight, electricEquip, fanElectric, pumpElectric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; plug-in component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
readeio = Honeybee_ReadHVACSizing(eioFile=exporttoopenstudio.eioFileAddress)  # -> zonePeakLoadObjs, zonePeakLoadVals, zoneSizingObjs, zoneSizingValues, systemSizingObjs, systemSizingVals, componentSizObjs, componentSizVals, coolDesignDayLoad, heatDesignDayLoad; plug-in component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
hbzones = Geometry(hvacsystem.HBZones)
lng = ListLength(List=hbzones)
flrnorm = Honeybee_NormalizeDataByFloorArea(simData=readepresult.electricEquip, HBZones=flatten(hbzones))  # -> totNormData, zoneNormData; plug-in component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
flrnorm_2 = Honeybee_NormalizeDataByFloorArea(simData=readepresult.electricLight, HBZones=flatten(hbzones))  # -> totNormData, zoneNormData; plug-in component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
flrnorm_3 = Honeybee_NormalizeDataByFloorArea(simData=readepresult.heating, HBZones=flatten(hbzones))  # -> totNormData, zoneNormData; plug-in component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
flrnorm_4 = Honeybee_NormalizeDataByFloorArea(simData=readepresult.pumpElectric, HBZones=flatten(hbzones))  # -> totNormData, zoneNormData; plug-in component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
flrnorm_5 = Honeybee_NormalizeDataByFloorArea(simData=readepresult.cooling, HBZones=flatten(hbzones))  # -> totNormData, zoneNormData; plug-in component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
flrnorm_6 = Honeybee_NormalizeDataByFloorArea(simData=readepresult.fanElectric, HBZones=flatten(hbzones))  # -> totNormData, zoneNormData; plug-in component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
series = Series(Start="1", Step="2", Count=lng)
series_2 = Series(Start="0", Step="2", Count=lng)
multiplication_2 = Multiplication(A=readeio.zoneSizingValues, B="3.412")
panel_7 = Panel(multiplication_2)
wh2btu = Ladybug_Whm2BTUft(Wh_m2=flrnorm.totNormData)  # -> BTU_ft2; plug-in component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
wh2btu_2 = Ladybug_Whm2BTUft(Wh_m2=flrnorm_2.totNormData)  # -> BTU_ft2; plug-in component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
wh2btu_3 = Ladybug_Whm2BTUft(Wh_m2=flrnorm_6.totNormData)  # -> BTU_ft2; plug-in component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
wh2btu_4 = Ladybug_Whm2BTUft(Wh_m2=flrnorm_3.totNormData)  # -> BTU_ft2; plug-in component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
wh2btu_5 = Ladybug_Whm2BTUft(Wh_m2=flrnorm_4.totNormData)  # -> BTU_ft2; plug-in component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
wh2btu_6 = Ladybug_Whm2BTUft(Wh_m2=flrnorm_5.totNormData)  # -> BTU_ft2; plug-in component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
item = ListItem(List=flatten(panel_7), Index=series_2, Wrap=True)
item_2 = ListItem(List=flatten(panel_7), Index=series, Wrap=True)
strnum = Ladybug_SeparateData(inputList=flatten(wh2btu))  # -> numbers, strings; plug-in component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
strnum_2 = Ladybug_SeparateData(inputList=flatten(wh2btu_2))  # -> numbers, strings; plug-in component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
strnum_3 = Ladybug_SeparateData(inputList=flatten(wh2btu_4))  # -> numbers, strings; plug-in component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
strnum_4 = Ladybug_SeparateData(inputList=flatten(wh2btu_5))  # -> numbers, strings; plug-in component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
strnum_5 = Ladybug_SeparateData(inputList=flatten(wh2btu_6))  # -> numbers, strings; plug-in component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
strnum_6 = Ladybug_SeparateData(inputList=flatten(wh2btu_3))  # -> numbers, strings; plug-in component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
ma = MassAddition(Input=item_2)  # -> Result, PartialResults
ma_2 = MassAddition(Input=item)  # -> Result, PartialResults
ma_3 = MassAddition(Input=strnum.numbers)  # -> Result, PartialResults
ma_4 = MassAddition(Input=strnum_2.numbers)  # -> Result, PartialResults
ma_5 = MassAddition(Input=strnum_3.numbers)  # -> Result, PartialResults
ma_6 = MassAddition(Input=strnum_4.numbers)  # -> Result, PartialResults
ma_7 = MassAddition(Input=strnum_5.numbers)  # -> Result, PartialResults
ma_8 = MassAddition(Input=strnum_6.numbers)  # -> Result, PartialResults
division_3 = Division(A=ma.Result, B="1000")
division_4 = Division(A=ma_2.Result, B="1000")
panel_8 = Panel([ma_7.Result, ma_5.Result, ma_4.Result, ma_3.Result, ma_8.Result, ma_6.Result])
zonesizing_heating_mbh = Panel(division_3)
zonesizing_cooling_mbh = Panel(division_4)
ma_9 = MassAddition(Input=panel_8)  # -> Result, PartialResults
end_use_intensity_kbtu_ft2 = Panel(ma_9.Result)
eui = Data(end_use_intensity_kbtu_ft2)
btu2wh = Ladybug_BTUft2Whm(BTU_ft2=eui)  # -> Wh_m2; plug-in component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

panel_9 = Panel(readeio.zoneSizingObjs)

# ----
# Collect Results and Iterate
panel_10 = Panel("800")
parameters = ColibriParameters(
    EUI=flatten(eui),
    ZoneSizing_Cooling_MBH=flatten(zonesizing_cooling_mbh),
    ZoneSizing_Heating_MBH=flatten(zonesizing_heating_mbh))
panel_11 = Panel("C:\Users\ryanschwartz\Documents\Presentations\BSUGEnergyResults\Iterations")

img_setting = ImageSetting(ImageSaveAsName="defaultName", RhinoViewNames="Perspective", Width=panel_10, Height=600)

aggregator = ColibriAggregator(
    Folder=panel_11,
    IterationGenomeID=iterator.Genome,
    IterationPhenomeResults=parameters,
    ImgSetting=img_setting,
    _3DObjects=flatten(_3dobjects),
    Write=Toggle(False),
    recordingMode=0)
panel_12 = Panel(aggregator)

# ==== cluster Sys05
hbzones = ClusterInput()
objparams = Ironbug_ObjParams(DataFieldSetType="Ironbug.HVAC.IB_BoilerHotWater_FieldSet")
f2c = Ladybug_F2C(F="180")  # -> C; plug-in component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

# ----
# Sys05_PackagedVAV_Reheat
# HBZones
data = Data(flatten(hbzones))

# ----
# Airloop
lng = ListLength(List=data)
coilhtnwater = Ironbug_CoilHeatingWater(dupNum=False)  # -> AirSide_CoilHeatingWater, WaterSide_CoilHeatingWater
duplicate = Ironbug_Duplicate(Reference=coilhtnwater.AirSide_CoilHeatingWater, Amount=flatten(lng))  # -> Objects, graft(WaterSide_CoilHeatingWater)
objparams_2 = Ironbug_ObjParams(EconomizerControlType="DifferentialDryBulb", DataFieldSetType="Ironbug.HVAC.IB_ControllerOutdoorAir_FieldSet")
objparams_3 = Ironbug_ObjParams(PressureRise="500", DataFieldSetType="Ironbug.HVAC.IB_FanVariableVolume_FieldSet")
oacontroller = Ironbug_OAController(Parameters_=objparams_2, dupNum=False)
objparams_4 = Ironbug_ObjParams(
    AllOutdoorAirinCooling=Toggle(False),
    AllOutdoorAirinHeating=Toggle(False),
    CentralHeatingDesignSupplyAirTemperature="12.8",
    DataFieldSetType="Ironbug.HVAC.IB_SizingSystem_FieldSet")
vavreheat = Ironbug_AirTerminalSingleDuctVAVReheat(HeatingCoil=duplicate.Objects, dupNum=False)
coilhtnwater_2 = Ironbug_CoilHeatingWater(dupNum=False)  # -> AirSide_CoilHeatingWater, WaterSide_CoilHeatingWater
oasystem = Ironbug_OutdoorAirSystem(Controller_=oacontroller)
thermalzone = Ironbug_ThermalZone(HoneybeeZonesOrOsZones=data, AirTerminal_=vavreheat, IsAirTerminalPriorToZoneEquipments=True, dupNum=False)
coilclndx2 = Ironbug_CoilCoolingDXTwoSpeed(dupNum=False)
fanvariable = Ironbug_FanVariableVolume(Parameters=objparams_3, dupNum=False)
spm_scheduled = Ironbug_SetpointManagerScheduled(Temperature="12.8", dupNum=False)
airloopbranches = AirLoopBranches(Branch1=thermalzone)
sizingsystem = Ironbug_SizingSystem(Parameters_=objparams_4, dupNum=False)
merge = Merge(Data1=oasystem, Data2=coilclndx2, Data3=coilhtnwater_2.AirSide_CoilHeatingWater, Data4=fanvariable, Data5=spm_scheduled)
airloop = Ironbug_AirLoopHVAC(Supply=merge, Demand=airloopbranches, SizingSystem=sizingsystem, dupNum=False)

# ----
# Hot water loop
boilerhw = Ironbug_BoilerHotWater(Parameters=objparams, dupNum=False)
pumpvariable = Ironbug_PumpVariableSpeed(dupNum=False)
branches = PlantBranches(Branch1=boilerhw, mapBranchToLoop=False)
branches_2 = PlantBranches(B1=duplicate.WaterSide_CoilHeatingWater, B2=coilhtnwater_2.WaterSide_CoilHeatingWater, mapBranchToLoop=False)
spm_scheduled_2 = Ironbug_SetpointManagerScheduled(Temperature=f2c, dupNum=False)
hwloop = Ironbug_HotWaterPlantLoop(Supply=[pumpvariable, branches, spm_scheduled_2], Demand=branches_2, dupNum=False)

hvacsystem = Ironbug_HVACSystem(AirLoops=flatten(airloop), PlantLoops=flatten(hwloop))

hvacsystem_2 = ClusterOutput(hvacsystem)
