# Grasshopper definition BSUG_Ladybug.gh (Grasshopper 1.0.7)

ladybug = Ladybug_Ladybug()  # -> Vviiiiiiiiiizzz; plug-in component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
# Load Weather File
epw_url = Panel("http://climate.onebuilding.org/WMO_Region_4_North_and_Central_America/USA_United_States_of_America/ID_Idaho/USA_ID_Boise.AP-Gowen.Field.ANGB.726810_TMYx.zip")
# Load Weather File
panel = Panel("http://climate.onebuilding.org/WMO_Region_4_North_and_Central_America/USA_United_States_of_America/ID_Idaho/USA_ID_Boise.AP-Gowen.Field.ANGB.726810_TMYx.zip")
# Load Weather File
epw_url_2 = Panel("http://climate.onebuilding.org/WMO_Region_4_North_and_Central_America/USA_United_States_of_America/ID_Idaho/USA_ID_Boise.AP-Gowen.Field.ANGB.726810_TMYx.zip")
# Load Weather File
epw_url_3 = Panel("http://climate.onebuilding.org/WMO_Region_4_North_and_Central_America/USA_United_States_of_America/ID_Idaho/USA_ID_Boise.AP-Gowen.Field.ANGB.726810_TMYx.zip")
epw_stat = Ladybug_OpenEPWAndSTATWeatherFiles(weatherFileURL=epw_url)  # -> epwFile, statFile; plug-in component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
epw_stat_2 = Ladybug_OpenEPWAndSTATWeatherFiles(weatherFileURL=panel)  # -> epwFile, statFile; plug-in component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
epw_stat_3 = Ladybug_OpenEPWAndSTATWeatherFiles(weatherFileURL=epw_url_2)  # -> epwFile, statFile; plug-in component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
epw_stat_4 = Ladybug_OpenEPWAndSTATWeatherFiles(weatherFileURL=epw_url_3)  # -> epwFile, statFile; plug-in component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
srf = Surface(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)
flip = Flip(Surface=srf)  # -> Surface, Result
importepw = Ladybug_ImportEpw(epwFile=epw_stat.epwFile)  # -> readMe, latitude, location, dryBulbTemperature, dewPointTemperature, relativeHumidity, windSpeed, windDirection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; plug-in component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
importepw_2 = Ladybug_ImportEpw(epwFile=epw_stat_2.epwFile)  # -> readMe, latitude, location, dryBulbTemperature, dewPointTemperature, relativeHumidity, windSpeed, windDirection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; plug-in component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
tof = Ladybug_TiltAndOrientationFactor(
    epwFile=epw_stat_4.epwFile,
    PV_SWHsurface=flip.Surface,
    annualShading=0,
    north=0,
    precision=20,
    scale=1,
    bakeIt=False,
    runIt=Toggle(False))  # -> readMe, port, TOF, TSRF, PVsurfaceTilt, PVsurfaceAzimuth, optimalTilt, optimalAzimuth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; plug-in component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
importepw_3 = Ladybug_ImportEpw(epwFile=epw_stat_3.epwFile)  # -> readMe, latitude, location, dryBulbTemperature, dewPointTemperature, relativeHumidity, windSpeed, windDirection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; plug-in component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
gradientlibrary = Ladybug_GradientLibrary(gradIndex="2")  # -> customColors; plug-in component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
activitieslist = Ladybug_ActivitiesMetList({"Sleeping": 0.7, "Reclining": 0.8, "Sitting": 1.0, "Typing": 1.1, "Standing": 1.2, "Driving": 1.5, "Cooking": 1.8, "House Cleaning": 2.7, "Strolling": 1.7, "Walking 2mph": 2.0, "Walking 3mph": 2.6, "Walking 4mph": 3.8, "Running 9mph": 9.5, "Lifting 10lbs": 2.1, "Lifting 100lbs": 4.0, "Shoveling": 4.4, "Dancing": 3.4, "Basketball": 6.3}, selected="Typing")
legendpar = Ladybug_LegendParameters(customColors=flatten(gradientlibrary), fontSize="1")  # -> legendPar; plug-in component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
c2f = Ladybug_C2F(C=importepw.dryBulbTemperature)  # -> F; plug-in component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
ms2mph = Ladybug_ms2mph(ms=importepw_2.windSpeed)  # -> mph; plug-in component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
geo = Geometry(Tree({0}: [Point(40, 0, 0.01)], {0;0}: [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]))
c2f_2 = Ladybug_C2F(C=importepw_3.dryBulbTemperature)  # -> F; plug-in component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
# Time Charts
_3dchart = Ladybug_3DChart(inputData=flatten(c2f_2), xScale="0.25", zScale="0")  # -> readMe, graphMesh, graphCurves, legend, legendBasePts, title, titleBasePts, dataPts, conditionalHOY; disabled; plug-in component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
# Wind Rose
windrose = Ladybug_WindRose(north=0, hourlyWindDirection=importepw_2.windDirection, hourlyWindSpeed=ms2mph, runIt=Toggle(False))  # -> readMe, calmRoseMesh, windRoseMesh, windRoseCrvs, windRoseCenPts, legend, legendBasePts, title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; plug-in component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
panel_2 = Panel("""0.5
1""")
mesh = Mesh([_3dchart.graphMesh, _3dchart.legend, _3dchart.title])
# Psychrometric Chart
psychchart = Ladybug_PsychrometricChart(
    dryBulbTemperature=c2f,
    relativeHumidity=importepw.relativeHumidity,
    barometricPressure=importepw.barometricPressure,
    metabolicRate=activitieslist,
    clothingLevel=panel_2,
    mergeComfPolygons=Toggle(False),
    enthalpyOrWetBulb=Toggle(False),
    legendPar=legendpar,
    runIt=Toggle(False))  # -> readMe, port, totalComfortPercent, totalComfortOrNot, strategyNames, strategyPercentOfTime, strategyOrNot, port_2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; plug-in component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
mesh_2 = Mesh([windrose.windRoseMesh, windrose.legend, windrose.title])
preview = CustomPreview(Geometry=_3dchart.graphCurves, Material=ColourSwatch(SwatchColor=RGB(0, 0, 0)))
preview_2 = CustomPreview(Geometry=windrose.windRoseCrvs, Material=ColourSwatch(SwatchColor=RGB(0, 0, 0)))
preview_3 = CustomPreview(Geometry=psychchart.comfortPolygons, Material=ColourSwatch(SwatchColor=RGB(198, 60, 0)))
preview_4 = CustomPreview(
    Geometry=[psychchart.chartCurvesAndTxt, psychchart.psychChartMesh, psychchart.legend],
    Material=ColourSwatch(SwatchColor=RGB(0, 0, 0)))
